vi "Alamouti_RX_student.gvi"   [LabVIEW NXG]
inputs:
  "Modulation Parameters In": T6 = {"Modulation Type"="QPSK", "Control Information\nfor Packet Header/Tail"={"Training Sequence 1 (derived)"=[], "Zero Pad Length"=0, "Training Sequence 2 (derived)"=[]}, "RX Oversample Factor"=20, "Synchronization Options"={"Synchronization Method"="Timing Estimation", "Fixed Offset"=0, "Symbol Timing Recovery Method"="Max Energy", "Frame Detection Method"="Sliding Correlator", "Correct Frequency Offset"=FALSE}, "Number of Data Symbols (Derived)"=250, "RX Sample Rate"=4000000, "Pulse Shaping Parameters"={"Modulation Type"="PSK", "Pulse Shaping Filter"="Raised Cosine", "Filter Parameter"=0.5, "Filter Length (Symbols)"=8}, "Channel Estimation/Equalization Parameters"={"Equalization Method"="Direct", "Channel Estimate Length"=4, "Equalizer Length"=4, "Equalizer Delay"=-1}}
  "Input Complex Symbols 1": c128[]
  "Input Complex Symbols 2": c128[]
  "Channel estimates": T7
  "error in (no error)": error
outputs:
  "Output Complex Symbols": c128[]
  "Modulation Parameters Out": T6
  "error out": error
types:
  T1 = cluster{"Training Sequence 1 (derived)": c128[], "Zero Pad Length": i32, "Training Sequence 2 (derived)": c128[]}
  T2 = cluster{"Synchronization Method": string, "Fixed Offset": i32, "Symbol Timing Recovery Method": string, "Frame Detection Method": string, "Correct Frequency Offset": bool}
  T3 = enum{"none", "Raised Cosine", "Root Raised Cos", "Gaussian"}
  T4 = cluster{"Modulation Type": enum{"FSK", "PSK", "QAM", "MSK", "PAM", "ASK"}, "Pulse Shaping Filter": T3, "Filter Parameter": f64, "Filter Length (Symbols)": i32}
  T5 = cluster{"Equalization Method": string, "Channel Estimate Length": i32, "Equalizer Length": i32, "Equalizer Delay": i32}
  T6 = cluster{"Modulation Type": string, "Control Information\nfor Packet Header/Tail": T1, "RX Oversample Factor": i32, "Synchronization Options": T2, "Number of Data Symbols (Derived)": i32, "RX Sample Rate": f64, "Pulse Shaping Parameters": T4, "Channel Estimation/Equalization Parameters": T5}
  T7 = cluster{"Element 1": c128[], "Element 2": c128[], "Element 3": c128[], "Element 4": c128[]}
diagram:
  call "Repeat.gvi"()
  Array Size(array=$"Input Complex Symbols 1") -> (size(s)=w1)
  Divide(x=w1, y=2) -> w2
  Divide(x=w1, y=64) -> w3
  Reshape Array(inArray=$"Input Complex Symbols 1", size=w3, size=64) -> w4
  for (N = w3) (iteration -> i1) {
    Multiply(2, i1) -> w7
    Array Index(array=w4) -> (out0[w7, _]=w8)
    Multiply(2, i1) -> w9
    Increment(x=w9) -> w10
    Array Index(array=w4) -> (out0[w10, _]=w11)
    append w8 to w5
    append w11 to w6
  }
  # R2[k], R6[k]
  Reshape Array(inArray=w6, size=w2) -> w12
  # R0[k],R4[k]
  Complex Conjugate(x + iy=w12) -> w13
  Property Node(instance in=$"Channel estimates") -> ("Element 1"=w14, "Element 2"=w15, "Element 3"=w16, "Element 4"=w17)
  Array Size(array=w13) -> (size(s)=w18)
  Divide(x=w18, y=64) -> w19
  call "Repeat.gvi"(Array=w15, Numeric=w19) -> (output array=w20)
  Multiply(w20, w13) -> w21
  Array Size(array=$"Input Complex Symbols 2") -> (size(s)=w22)
  Divide(x=w22, y=2) -> w23
  Divide(x=w22, y=64) -> w24
  Reshape Array(inArray=$"Input Complex Symbols 2", size=w24, size=64) -> w25
  for (N = w24) (iteration -> i2) {
    Multiply(2, i2) -> w28
    Array Index(array=w25) -> (out0[w28, _]=w29)
    Multiply(2, i2) -> w30
    Increment(x=w30) -> w31
    Array Index(array=w25) -> (out0[w31, _]=w32)
    append w32 to w26
    append w29 to w27
  }
  Reshape Array(inArray=w27, size=w23) -> w33
  # H1[k]*
  # H2[k]*
  Complex Conjugate(x + iy=w16) -> w34
  Array Size(array=w33) -> (size(s)=w35)
  Divide(x=w35, y=64) -> w36
  call "Repeat.gvi"(Array=w34, Numeric=w36) -> (output array=w37)
  Multiply(w37, w33) -> w38
  # R1[k],R5[k]
  Reshape Array(inArray=w5, size=w2) -> w39
  # Ho[k]*
  Complex Conjugate(x + iy=w14) -> w40
  Array Size(array=w39) -> (size(s)=w41)
  Divide(x=w41, y=64) -> w42
  call "Repeat.gvi"(Array=w40, Numeric=w42) -> (output array=w43)
  Multiply(w43, w39) -> w44
  # R3[k],R7[k]
  Reshape Array(inArray=w26, size=w23) -> w45
  Complex Conjugate(x + iy=w45) -> w46
  Array Size(array=w46) -> (size(s)=w47)
  Divide(x=w47, y=64) -> w48
  call "Repeat.gvi"(Array=w17, Numeric=w48) -> (output array=w49)
  Multiply(w49, w46) -> w50
  # ~s0,~s2,~s4
  Add(w44, w21, w38, w50) -> w51
  Array Size(array=w13) -> (size(s)=w52)
  Divide(x=w52, y=64) -> w53
  call "Repeat.gvi"(Array=w14, Numeric=w53) -> (output array=w54)
  Multiply(w54, w13, -1+0i) -> w55
  # H3[k]*
  Complex Conjugate(x + iy=w17) -> w56
  Array Size(array=w33) -> (size(s)=w57)
  Divide(x=w57, y=64) -> w58
  call "Repeat.gvi"(Array=w56, Numeric=w58) -> (output array=w59)
  Multiply(w59, w33) -> w60
  Array Size(array=w46) -> (size(s)=w61)
  Divide(x=w61, y=64) -> w62
  call "Repeat.gvi"(Array=w16, Numeric=w62) -> (output array=w63)
  Multiply(w63, w46, -1+0i) -> w64
  Complex Conjugate(x + iy=w15) -> w65
  Array Size(array=w39) -> (size(s)=w66)
  Divide(x=w66, y=64) -> w67
  call "Repeat.gvi"(Array=w65, Numeric=w67) -> (output array=w68)
  # ~s1,~s3,~s5
  Multiply(w68, w39) -> w69
  Add(w69, w55, w60, w64) -> w70
  Interleave Array(w51, w70) -> w71
  # a0[k]
  Absolute Value(x=w14) -> w72
  Square(x=w72) -> w73
  # a1[k]
  Absolute Value(x=w15) -> w74
  Square(x=w74) -> w75
  Absolute Value(x=w16) -> w76
  # a2[k]
  Square(x=w76) -> w77
  Absolute Value(x=w17) -> w78
  # a3[k]
  Square(x=w78) -> w79
  Add(w73, w75, w77, w79) -> w80
  Array Size(array=w71) -> (size(s)=w81)
  Divide(x=w81, y=64) -> w82
  call "Repeat.gvi"(Array=w80, Numeric=w82) -> (output array=w83)
  Divide(x=w71, y=w83) -> w84
  $"Output Complex Symbols" <- w84
  $"error out" <- $"error in (no error)"
  $"Modulation Parameters Out" <- $"Modulation Parameters In"
