vi "Alamouti_TX_student.gvi"   [LabVIEW NXG]
inputs:
  "input symbols": c128[] = [1+0i, 2+0i, 3+0i, 4+0i, 0.707106781187+0.707106781187i, -0.707106781187+0.707106781187i, 0.707106781187+0.707106781187i, -0.707106781187-0.707106781187i, -0.707106781187+0.707106781187i, 0.707106781187+0.707106781187i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]
  "Modulation Parameters In": T4 = {"Modulation Type"="QPSK", "Pulse Shaping Parameters"={"Modulation Type"="PSK", "Pulse Shaping Filter"="Raised Cosine", "Filter Parameter"=0.5, "Filter Length (Symbols)"=8}, "TX Oversample Factor"=20, "Packet Length (Bits)"=500, "TX Sample Rate"=100, "Control Information For Packet Header/Tail"={"Training Sequences"="Length 11 Barker Sequence", "Zero Pad Length"=8}}
  "error in (no error)": error
outputs:
  "Modulation Parameters Out": T6
  "output 1": c128[]
  "output 2": c128[]
  "error out": error
types:
  T1 = enum{"none", "Raised Cosine", "Root Raised Cos", "Gaussian"}
  T2 = cluster{"Modulation Type": enum{"FSK", "PSK", "QAM", "MSK", "PAM", "ASK"}, "Pulse Shaping Filter": T1, "Filter Parameter": f64, "Filter Length (Symbols)": i32}
  T3 = cluster{"Training Sequences": string, "Zero Pad Length": i32}
  T4 = cluster{"Modulation Type": string, "Pulse Shaping Parameters": T2, "TX Oversample Factor": i32, "Packet Length (Bits)": i32, "TX Sample Rate": f64, "Control Information For Packet Header/Tail": T3}
  T5 = cluster{"Training Sequences ": string, "Zero Pad Length": i32}
  T6 = cluster{"Modulation Type": string, "Pulse Shaping Parameters": T2, "TX Oversample Factor": i32, "Packet Length (Bits)": i32, "TX Sample Rate": f64, "Control Information For Packet Header/Tail": T5}
diagram:
  case ($"error in (no error)") {
    frame No Error {
      # s1
      Decimate Array(array=$"input symbols") -> (out0=w2, out1=w3)
      # antenna 0
      Complex Conjugate(x + iy=w3) -> w4
      # s0
      # -s1*
      Multiply(w4, -1) -> w5
      Array Size(array=w2) -> (size(s)=w6)
      Divide(x=w6, y=128) -> w7
      Round Toward Positive Infinity(x=w7) -> w8
      for (N = w8) (iteration -> i1) {
        Multiply(128, i1) -> w10
        Array Subset(array=w2, index0=w10, length0=128) -> w11
        Array Subset(array=w5, index0=w10, length0=128) -> w12
        Build Array(w11, w12) -> w13
        append w13 to w9
      }
      Multiply(2, 128, w8) -> w14
      Reshape Array(inArray=w9, size=w14) -> w15
      # [128 de s0, 128 de -s1*, etc...]
      $"output 1" <- w15
      # antenna 1
      # s1
      # s0*
      Complex Conjugate(x + iy=w2) -> w16
      Array Size(array=w3) -> (size(s)=w17)
      Divide(x=w17, y=128) -> w18
      Round Toward Positive Infinity(x=w18) -> w19
      for (N = w19) (iteration -> i2) {
        Multiply(128, i2) -> w21
        Array Subset(array=w3, index0=w21, length0=128) -> w22
        Array Subset(array=w16, index0=w21, length0=128) -> w23
        Build Array(w22, w23) -> w24
        append w24 to w20
      }
      Multiply(w19, 2, 128) -> w25
      Reshape Array(inArray=w20, size=w25) -> w26
      # [128 de s1, 128 de s0*, etc ...]
      $"output 2" <- w26
      w1 = $"error in (no error)"
    }
    frame Error {
      w1 = $"error in (no error)"
    }
  }
  $"error out" <- w1
  $"Modulation Parameters Out" <- $"Modulation Parameters In"
