vi "Training sequence preprocessing_student.gvi"   [LabVIEW NXG]
inputs:
  "error in (no error)": error
  "Training Sequences in": T1 = {"Length 11 Zadoff Chu 1 "=[1+0i, 1+0i, 1+0i, 0+0i, 1+0i, 1+0i, 0+0i, 1+0i, 0+0i, 0+0i, 0+0i], "Length 11 Zadoff Chu 2"=[1+0i, 0+0i, 1+0i, 1+0i, 0+0i, 1+0i, 0+0i, 0+0i, 0+0i, 1+0i, 1+0i]}
outputs:
  "Training Sequences out": T1
  "error out": error
types:
  T1 = cluster{"Length 11 Zadoff Chu 1 ": c128[], "Length 11 Zadoff Chu 2": c128[]}
diagram:
  Property Node(instance in=$"Training Sequences in") -> ("Length 11 Zadoff Chu 1 "=w1, "Length 11 Zadoff Chu 2"=w2)
  Build Array[ConcatenateInputs=True](w1, w1, w1, w1, w1, w1, w1, w1, w1, w1, w1, w1) -> w3
  Array Subset(array=w3, index0=0, length0=128) -> w4
  Array Size(array=w4) -> (size(s)=w5)
  Initialize Array(element=0+0i, size=w5) -> w6
  Build Array[ConcatenateInputs=True](w4, w6) -> w7
  # data(128);0
  call "Inverse Complex FFT.gvi"(FFT {x}=w7) -> (x=w8)
  Build Array[ConcatenateInputs=True](w2, w2, w2, w2, w2, w2, w2, w2, w2, w2, w2, w2) -> w9
  Array Subset(array=w9, index0=0, length0=128) -> w10
  Array Size(array=w10) -> (size(s)=w11)
  Initialize Array(element=0+0i, size=w11) -> w12
  Build Array[ConcatenateInputs=True](w12, w10) -> w13
  # 0;data(128)
  call "Inverse Complex FFT.gvi"(FFT {x}=w13) -> (x=w14)
  Build Cluster(w8, w14) -> w15
  $"Training Sequences out" <- w15
  $"error out" <- $"error in (no error)"
