vi "Training sequence preprocessing_student_receiver.gvi"   [LabVIEW NXG]
inputs:
  "error in (no error)": error
  "Training Sequences in": T1 = {"Length 11 Zadoff Chu 1 "=[1+0i, 1+0i, 1+0i, 0+0i, 1+0i, 1+0i, 0+0i, 1+0i, 0+0i, 0+0i, 0+0i], "Length 11 Zadoff Chu 2"=[1+0i, 0+0i, 1+0i, 1+0i, 0+0i, 1+0i, 0+0i, 0+0i, 0+0i, 1+0i, 1+0i]}
outputs:
  "Training Sequences out": T1
  "error out": error
types:
  T1 = cluster{"Length 11 Zadoff Chu 1 ": c128[], "Length 11 Zadoff Chu 2": c128[]}
diagram:
  Property Node(instance in=$"Training Sequences in") -> ("Length 11 Zadoff Chu 1 "=w1, "Length 11 Zadoff Chu 2"=w2)
  Build Array[ConcatenateInputs=True](w1, w1, w1, w1, w1, w1, w1, w1, w1, w1, w1, w1) -> w3
  Array Subset(array=w3, index0=0, length0=64) -> w4
  Array Size(array=w4) -> (size(s)=w5)
  Initialize Array(element=0+0i, size=w5) -> w6
  # data(64);0
  Build Array[ConcatenateInputs=True](w4, w6) -> w7
  Build Array[ConcatenateInputs=True](w2, w2, w2, w2, w2, w2, w2, w2, w2, w2, w2, w2) -> w8
  Array Subset(array=w8, index0=0, length0=64) -> w9
  Array Size(array=w9) -> (size(s)=w10)
  Initialize Array(element=0+0i, size=w10) -> w11
  # 0;data(64)
  Build Array[ConcatenateInputs=True](w11, w9) -> w12
  Build Cluster(w7, w12) -> w13
  $"Training Sequences out" <- w13
  $"error out" <- $"error in (no error)"
