vi "channel_estimate_MIMO_student.gvi"   [LabVIEW NXG]
inputs:
  "Modulation Parameters In": T6 = {"Modulation Type"="QPSK", "Control Information\nfor Packet Header/Tail"={"Training Sequence 1 (derived)"=[], "Zero Pad Length"=0, "Training Sequence 2 (derived)"=[]}, "RX Oversample Factor"=20, "Synchronization Options"={"Synchronization Method"="Timing Estimation", "Fixed Offset"=0, "Symbol Timing Recovery Method"="Max Energy", "Frame Detection Method"="Sliding Correlator", "Correct Frequency Offset"=FALSE}, "Number of Data Symbols (Derived)"=250, "RX Sample Rate"=4000000, "Pulse Shaping Parameters"={"Modulation Type"="PSK", "Pulse Shaping Filter"="Raised Cosine", "Filter Parameter"=0.5, "Filter Length (Symbols)"=8}, "Channel Estimation/Equalization Parameters"={"Equalization Method"="Direct", "Channel Estimate Length"=4, "Equalizer Length"=4, "Equalizer Delay"=-1}}
  "Input Symbol Sequence 1": c128[]
  "Input Symbol Sequence 2": c128[]
  "error in (no error)": error
outputs:
  "Modulation Parameters Out": T6
  "Channel estimates": T7
  "Mean-Square Error": f64
  "error out": error
types:
  T1 = cluster{"Training Sequence 1 (derived)": c128[], "Zero Pad Length": i32, "Training Sequence 2 (derived)": c128[]}
  T2 = cluster{"Synchronization Method": string, "Fixed Offset": i32, "Symbol Timing Recovery Method": string, "Frame Detection Method": string, "Correct Frequency Offset": bool}
  T3 = enum{"none", "Raised Cosine", "Root Raised Cos", "Gaussian"}
  T4 = cluster{"Modulation Type": enum{"FSK", "PSK", "QAM", "MSK", "PAM", "ASK"}, "Pulse Shaping Filter": T3, "Filter Parameter": f64, "Filter Length (Symbols)": i32}
  T5 = cluster{"Equalization Method": string, "Channel Estimate Length": i32, "Equalizer Length": i32, "Equalizer Delay": i32}
  T6 = cluster{"Modulation Type": string, "Control Information\nfor Packet Header/Tail": T1, "RX Oversample Factor": i32, "Synchronization Options": T2, "Number of Data Symbols (Derived)": i32, "RX Sample Rate": f64, "Pulse Shaping Parameters": T4, "Channel Estimation/Equalization Parameters": T5}
  T7 = cluster{"Element 1": c128[], "Element 2": c128[], "Element 3": c128[], "Element 4": c128[]}
diagram:
  $"Modulation Parameters Out" <- $"Modulation Parameters In"
  case ($"error in (no error)") {
    frame No Error {
      $"Mean-Square Error" <- 0
      Array Subset(array=$"Input Symbol Sequence 2", index0=64, length0=64) -> w2
      call "Complex FFT.gvi"(x=w2) -> (FFT {x}=w3)
      Property Node(instance in=$"Modulation Parameters In") -> ("Control Information\nfor Packet Header/Tail:Training Sequence 1 (derived)"=w4, "Control Information\nfor Packet Header/Tail:Training Sequence 2 (derived)"=w5)
      Array Subset(array=w5, index0=64, length0=64) -> w6
      # H3[k]
      Divide(x=w3, y=w6) -> w7
      Array Subset(array=$"Input Symbol Sequence 2", index0=0, length0=64) -> w8
      call "Complex FFT.gvi"(x=w8) -> (FFT {x}=w9)
      Array Subset(array=w4, index0=0, length0=64) -> w10
      # H2[k]
      Divide(x=w9, y=w10) -> w11
      Array Subset(array=$"Input Symbol Sequence 1", index0=64, length0=64) -> w12
      call "Complex FFT.gvi"(x=w12) -> (FFT {x}=w13)
      # H1[k]
      Divide(x=w13, y=w6) -> w14
      Array Subset(array=$"Input Symbol Sequence 1", index0=0, length0=64) -> w15
      call "Complex FFT.gvi"(x=w15) -> (FFT {x}=w16)
      # H0[k]
      Divide(x=w16, y=w10) -> w17
      Build Cluster(w17, w14, w11, w7) -> w18
      $"Channel estimates" <- w18
      w1 = $"error in (no error)"
    }
    frame Error {
      w1 = $"error in (no error)"
    }
  }
  $"error out" <- w1
