vi "receiver_MIMO.gvi"   [LabVIEW NXG]
inputs:
  "HW Parameters In": T1 = {"Active Antenna"="RX1", "Carrier Frequency (Hz)"=915000000, "Gain (dB)"=10, "Trigger Level"=0.01, "Bandwidth (Hz)"=40000000, "Reference Position (%)"=10, "Capture Time (s)"=0.002, "Simulate"=FALSE, "Device IP Address"="192.168.10.2"}
  "Modulation Parameters In": T7 = {"Modulation Type"="QPSK", "Control Information\nfor Packet Header/Tail"={"Training Sequence 1 (derived)"=[], "Zero Pad Length"=0, "Training Sequence 2 (derived)"=[]}, "RX Oversample Factor"=20, "Synchronization Options"={"Synchronization Method"="Timing Estimation", "Fixed Offset"=0, "Symbol Timing Recovery Method"="Max Energy", "Frame Detection Method"="Sliding Correlator", "Correct Frequency Offset"=FALSE}, "Number of Data Symbols (Derived)"=100, "RX Sample Rate"=4000000, "Pulse Shaping Parameters"={"Modulation Type"="PSK", "Pulse Shaping Filter"="Root Raised Cos", "Filter Parameter"=0.5, "Filter Length (Symbols)"=8}, "Channel Estimation/Equalization Parameters"={"Equalization Method"="Direct", "Channel Estimate Length"=1, "Equalizer Length"=1, "Equalizer Delay"=-1}}
  "queue in": cluster{"Key Bit Sequence": Queue<u8[]>}
  "error in (no error)": error
  "Input Complex Waveform 1": cluster{"t0": f64, "dt": f64, "Y": c128[]}
  "OFDM Parameters In": T14 = {"FFT size (N)"=64, "Length of CP (Lc)"=8, "Null Tones"=[0, 30, 31, 32], "Number of OFDM Symbols (derived)"=1, "Training Sequence FFT size"=0, "Training Sequence Length of CP"=0}
  "Input Complex Waveform 2": cluster{"t0": f64, "dt": f64, "Y": c128[]}
outputs:
  "error out": error
  "Modulation Parameters Out": T7
  "HW Parameters Out": T1
  "queue out": cluster{"Key Bit Sequence": Queue<u8[]>}
  "Measured channel impairements": T10
  "Overhead Offset": i32
  "Symbol Rate": f64
  "Bit-Error Rate": f64
  "Offset 1": i32
  "RX Waveforms Out 2": T8
  "RX Waveforms Out 1": T8
  "Received Constellation": T12[]
  "Power delay profiles": T11
  "Offset 2": i32
  "Key Bit Sequence": i8[]
panel controls:
  "Training Sequences In": T13 = {"Length 11 Zadoff Chu 1 "=[1+0i, 1+0i, 1+0i, 0+0i, 1+0i, 1+0i, 0+0i, 1+0i, 0+0i, 0+0i, 0+0i], "Length 11 Zadoff Chu 2"=[1+0i, 0+0i, 1+0i, 1+0i, 0+0i, 1+0i, 0+0i, 0+0i, 0+0i, 1+0i, 1+0i]}
  "Modulation Parameters In": T16 = {"Control Information\nfor Packet Header/Tail"={"Training Sequence Type"="IEEE 802.11a Short", "Training Sequence (derived)"=[], "Zero Pad Length"=0}, "RX Oversample Factor"=20, "Synchronization Options"={"Synchronization Method"="Timing Estimation", "Fixed Offset"=0, "Symbol Timing Recovery Method"="Max Energy", "Frame Detection Method"="Sliding Correlator", "Correct Frequency Offset"=FALSE}, "Number of Data Symbols (Derived)"=100, "RX Sample Rate"=4000000, "Pulse Shaping Parameters"={"Modulation Type"="PSK", "Pulse Shaping Filter"="Root Raised Cos", "Filter Parameter"=0.5, "Filter Length (Symbols)"=8}, "Channel Estimation/Equalization Parameters"={"Equalization Method"="Direct", "Channel Estimate Length"=1, "Equalizer Length"=1, "Equalizer Delay"=-1}, "Equalize Channel"=FALSE, "Modulation Type"="QPSK"}
panel indicators:
  "Y": c128[]
types:
  T1 = cluster{"Active Antenna": string, "Carrier Frequency (Hz)": f64, "Gain (dB)": f64, "Trigger Level": f64, "Bandwidth (Hz)": f64, "Reference Position (%)": f64, "Capture Time (s)": f64, "Simulate": bool, "Device IP Address": string}
  T2 = cluster{"Training Sequence 1 (derived)": c128[], "Zero Pad Length": i32, "Training Sequence 2 (derived)": c128[]}
  T3 = cluster{"Synchronization Method": string, "Fixed Offset": i32, "Symbol Timing Recovery Method": string, "Frame Detection Method": string, "Correct Frequency Offset": bool}
  T4 = enum{"none", "Raised Cosine", "Root Raised Cos", "Gaussian"}
  T5 = cluster{"Modulation Type": enum{"FSK", "PSK", "QAM", "MSK", "PAM", "ASK"}, "Pulse Shaping Filter": T4, "Filter Parameter": f64, "Filter Length (Symbols)": i32}
  T6 = cluster{"Equalization Method": string, "Channel Estimate Length": i32, "Equalizer Length": i32, "Equalizer Delay": i32}
  T7 = cluster{"Modulation Type": string, "Control Information\nfor Packet Header/Tail": T2, "RX Oversample Factor": i32, "Synchronization Options": T3, "Number of Data Symbols (Derived)": i32, "RX Sample Rate": f64, "Pulse Shaping Parameters": T5, "Channel Estimation/Equalization Parameters": T6}
  T8 = cluster{"Eye Diagram": cluster{"t0": f64, "dt": f64, "Y": f64[]}[], "Power Delay Profile 1": DoubleAnalogWaveform, "IQ Graph": cluster{"Element 1": f64[], "Element 2": f64[]}[], "Power Delay Profile 2": DoubleAnalogWaveform}
  T9 = cluster{"Element 1": c128[], "Element 2": c128[], "Element 3": c128[], "Element 4": c128[]}
  T10 = cluster{"SNR(dB)": f64, "freq. offset 1": f64, "delay 1": f64, "Channel estimates": T9, "freq. offset 2": f64, "delay 2": f64}
  T11 = cluster{"Element 1": DoubleAnalogWaveform, "Element 2": DoubleAnalogWaveform, "Element 3": DoubleAnalogWaveform, "Element 4": DoubleAnalogWaveform}
  T12 = cluster{"constellation": f64[], "oversampled data": f64[]}
  T13 = cluster{"Length 11 Zadoff Chu 1 ": c128[], "Length 11 Zadoff Chu 2": c128[]}
  T14 = cluster{"FFT size (N)": i32, "Length of CP (Lc)": i32, "Null Tones": u32[], "Number of OFDM Symbols (derived)": i32, "Training Sequence FFT size": i32, "Training Sequence Length of CP": i32}
  T15 = cluster{"Training Sequence Type": string, "Training Sequence (derived)": c128[], "Zero Pad Length": i32}
  T16 = cluster{"Control Information\nfor Packet Header/Tail": T15, "RX Oversample Factor": i32, "Synchronization Options": T3, "Number of Data Symbols (Derived)": i32, "RX Sample Rate": f64, "Pulse Shaping Parameters": T5, "Channel Estimation/Equalization Parameters": T6, "Equalize Channel": bool, "Modulation Type": string}
diagram:
  $"HW Parameters Out" <- $"HW Parameters In"
  case ($"error in (no error)") {
    frame No Error {
      Property Node(instance in=$"Input Complex Waveform 1") -> ("Y"=w4)
      $Y <- w4
      call "Training sequence preprocessing_student_receiver.gvi"(error in (no error)=$"error in (no error)", Training Sequences in=$"Training Sequences In") -> (Training Sequences out=w5, error out=w6)
      call "receiver_init (SubVI).gvi"(Modulation Parameters In=$"Modulation Parameters In", queue in=$"queue in", error in=w6, Training Sequences=w5) -> (Modulation Parameters Out=w7, queue out=w3, symbol rate=w8, key bit sequence=w9, overhead offset=w10, error out=w11)
      call "matched_filtering_MIMO.gviprotected"(Modulation Parameters In=w7, Input Complex Waveform 1=$"Input Complex Waveform 1", Input Complex Waveform 2=$"Input Complex Waveform 2", error in (no error)=w11) -> (Modulation Parameters Out=w12, Output Complex Waveform 1=w13, Output Complex Waveform 2=w14, error out=w15)
      call "synchronize_MIMO.gvi"(Modulation Parameters In=w12, Input Complex Waveform 1=w13, Input Complex Waveform 2=w14, error in (no error)=w15) -> (Modulation Parameters Out=w16, Output Complex Symbols 1=w17, Intermediate Complex Waveform 2=w18, Offset 1=w19, error out=w20, Intermediate Complex Waveform 1=w21, Estimated Frequency Offset 1=w22, Output Complex Symbols 2=w23, Offset 2=w24, Estimated Frequency Offset 2=w25)
      call "channel_estimate_MIMO_student.gvi"(Modulation Parameters In=w16, Input Symbol Sequence 1=w17, Input Symbol Sequence 2=w23, error in (no error)=w20) -> (Modulation Parameters Out=w26, Channel estimates=w27, Mean-Square Error=w28, error out=w29)
      call "receiver_channel_impairments_MIMO (SubVI).gvi"(Modulation Parameters In=w26, mean-squared error=w28, Channel estimates=w27, offset 1=w19, estimated frequency offset 1=w22, offset 2=w24, overhead offset=w10, estimated frequency offset 2=w25) -> (Measured channel impairements=w30)
      # 1.Determine the number of data symbols, the symbol rate, the overhead
      # offset, and get the key bit sequence and training sequence from the queue
      Property Node(instance in=w26) -> ("RX Oversample Factor"=w31, "Synchronization Options"=w32, "Number of Data Symbols (Derived)"=w33, "RX Sample Rate"=w34, "Pulse Shaping Parameters"=w35, "Channel Estimation/Equalization Parameters"=w36, "Modulation Type"=w37)
      # 1.Determine the number of data symbols and get the key bit sequence and training sequence from the queue
      # 2. Process baseband signal
      # 3. Plot the symbol constellation and eye diagram for recovered symbols
      # 2. Process baseband signal
      Property Node(instance in=$"Modulation Parameters In", "RX Oversample Factor"=w31, "Synchronization Options"=w32, "Number of Data Symbols (Derived)"=w33, "RX Sample Rate"=w34, "Pulse Shaping Parameters"=w35, "Channel Estimation/Equalization Parameters"=w36, "Equalize Channel"=FALSE, "Modulation Type"=w37) -> (instance out=w38)
      call "OFDM_strip_control.gviprotected"(Modulation Parameters In=w38, Input=w17, OFDM Parameters in=$"OFDM Parameters In", error in (no error)=w29) -> (Data Symbols=w39, error out=w40)
      call "OFDM_strip_control.gviprotected"(Modulation Parameters In=w38, Input=w23, OFDM Parameters in=$"OFDM Parameters In") -> (Data Symbols=w41)
      call "OFDM_demodulator.gviprotected"(Modulation Parameters In=w38, Received Samples=w41, OFDM Parameters in=$"OFDM Parameters In", channel estimate=c128[] []) -> (Demodulated Symbols=w42)
      call "OFDM_demodulator.gviprotected"(Modulation Parameters In=w38, Received Samples=w39, OFDM Parameters in=$"OFDM Parameters In", channel estimate=c128[] []) -> (Demodulated Symbols=w43)
      call "Alamouti_RX_student.gvi"(Modulation Parameters In=w26, Input Complex Symbols 1=w43, Input Complex Symbols 2=w42, Channel estimates=w27, error in (no error)=w40) -> (Output Complex Symbols=w44, Modulation Parameters Out=w45, error out=w46)
      call "decode.gviprotected"(Modulation Parameters In=w45, input symbols=w44, error in (no error)=w46) -> (Modulation Parameters Out=w47, decoded bit stream=w48, error out=w49)
      # 3. Plot the symbol constellation and eye diagram for recovered symbols
      # recovered symbols
      call "receiver_generate_waveforms (SubVI).gvi"(Modulation Parameters In=w47, Intermediate Complex Waveform 1=w21, Data Symbols=w44, Measured channel impairements=w30, Intermediate Complex Waveform 2=w18) -> (Modulation Parameters Out=w2, RX Waveforms Out 1=w50, Power delay profiles=w51, RX Waveforms Out 2=w52, Received Constellation=w53)
      $"RX Waveforms Out 1" <- w50
      $"Symbol Rate" <- w8
      $"RX Waveforms Out 2" <- w52
      $"Received Constellation" <- w53
      $"Power delay profiles" <- w51
      # key bit sequence
      $"Offset 1" <- w19
      call "error_detect.gvi"(input bit sequence=w48, key bit sequence=w9, error in (no error)=w49) -> (bit-error rate=w54, error out=w1)
      $"Bit-Error Rate" <- w54
      $"Offset 2" <- w24
      $"Key Bit Sequence" <- w9
      $"Overhead Offset" <- w10
      $"Measured channel impairements" <- w30
      Property Node(instance in=w26)
      Property Node(instance in=w26)
    }
    frame Error {
      w1 = $"error in (no error)"
      w2 = $"Modulation Parameters In"
      w3 = $"queue in"
    }
  }
  $"Modulation Parameters Out" <- w2
  $"error out" <- w1
  $"queue out" <- w3
