vi "simulator.gvi"   [LabVIEW NXG]
panel controls:
  "# of Iterations": i32 = 1
  "Control Information for Packet Header/Tail": T1 = {"Training Sequences"="Zadoff Chu", "Zero Pad Length"=8}
  "Pulse Shaping Parameters": T3 = {"Modulation Type"="PSK", "Pulse Shaping Filter"="Raised Cosine", "Filter Parameter"=0.5, "Filter Length (Symbols)"=8}
  "Packet Length (Bits)": i32 = 500
  "RX Oversample Factor": i32 = 4
  "RX Sample Rate": f64 = 4000000
  "TX Sample Rate": f64 = 4000000
  "TX Oversample Factor": i32 = 4
  "RX HW Parameters": T4 = {"Active Antenna"="RX1", "Carrier Frequency (Hz)"=915000000, "Gain (dB)"=10, "Trigger Level"=0.01, "Bandwidth (Hz)"=915000000, "Reference Position (%)"=10, "Capture Time (s)"=0.0033, "Simulate"=FALSE, "Device IP Address"="192.168.11.2"}
  "Channel Model Parameters": T5 = {"Noise Power (dB)"=-Inf, "Channel Model"="AWGN"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}
  "TX HW Parameters": T6 = {"Active Antenna"="TX1", "Carrier Frequency (Hz)"=915000000, "Gain (dB)"=10, "Generation Mode"="Simulate", "Device IP Address"="192.168.11.3"}
  "Modulation Type": string = "QPSK"
  "Channel Estimation/Equalization Parameters": T7 = {"Equalization Method"="Direct", "Channel Estimate Length"=4, "Equalizer Length"=4, "Equalizer Delay"=-1}
  "Synchronization Options": T8 = {"Synchronization Method"="Timing Estimation", "Fixed Offset"=0, "Symbol Timing Recovery Method"="Max Energy", "Frame Detection Method"="Sliding Correlator", "Correct Frequency Offset"=FALSE}
  "Plots": i32
  "RX modulation parameters": T11 = {"Modulation Type"="QPSK", "Control Information\nfor Packet Header/Tail"={"Training Sequence 1 (derived)"=[], "Zero Pad Length"=0, "Training Sequence 2 (derived)"=[]}, "RX Oversample Factor"=20, "Synchronization Options"={"Synchronization Method"="Timing Estimation", "Fixed Offset"=0, "Symbol Timing Recovery Method"="Max Energy", "Frame Detection Method"="Sliding Correlator", "Correct Frequency Offset"=FALSE}, "Number of Data Symbols (Derived)"=250, "RX Sample Rate"=4000000, "Pulse Shaping Parameters"={"Modulation Type"="PSK", "Pulse Shaping Filter"="Raised Cosine", "Filter Parameter"=0.5, "Filter Length (Symbols)"=8}, "Channel Estimation/Equalization Parameters"={"Equalization Method"="Direct", "Channel Estimate Length"=4, "Equalizer Length"=4, "Equalizer Delay"=-1}}
  "TX modulation Parameters": T13 = {"Modulation Type"="QPSK", "Pulse Shaping Parameters"={"Modulation Type"="PSK", "Pulse Shaping Filter"="Raised Cosine", "Filter Parameter"=0.5, "Filter Length (Symbols)"=8}, "TX Oversample Factor"=20, "Packet Length (Bits)"=500, "TX Sample Rate"=4000000, "Control Information For Packet Header/Tail"={"Training Sequences "="Length 11 Barker Sequence", "Zero Pad Length"=8}}
panel indicators:
  "Average Bit-Error Rate": f64
  "Error Statistic (averaged over the two antennas)": f64
  "Estimated time Offset 1": i32
  "error out": error
  "Received Constellation": T9[]
  "Received Eye Diagram 2": cluster{"t0": f64, "dt": f64, "Y": f64[]}[]
  "Power Delay Profile h_11": waveform<f64>
  "Q Data RX 1": waveform<f64>
  "I Data RX 1": waveform<f64>
  "Received Eye Diagram 1": cluster{"t0": f64, "dt": f64, "Y": f64[]}[]
  "Power Delay Profile h_12": waveform<f64>
  "Power Delay Profile h_21": waveform<f64>
  "Power Delay Profile h_22": waveform<f64>
  "Estimated time Offset 2": i32
  "Measured channel impairements": T15
  "I Data RX 2": waveform<f64>
  "Q Data RX 2": waveform<f64>
types:
  T1 = cluster{"Training Sequences": string, "Zero Pad Length": i32}
  T2 = enum{"none", "Raised Cosine", "Root Raised Cos", "Gaussian"}
  T3 = cluster{"Modulation Type": enum{"FSK", "PSK", "QAM", "MSK", "PAM", "ASK"}, "Pulse Shaping Filter": T2, "Filter Parameter": f64, "Filter Length (Symbols)": i32}
  T4 = cluster{"Active Antenna": string, "Carrier Frequency (Hz)": f64, "Gain (dB)": f64, "Trigger Level": f64, "Bandwidth (Hz)": f64, "Reference Position (%)": f64, "Capture Time (s)": f64, "Simulate": bool, "Device IP Address": string}
  T5 = cluster{"Noise Power (dB)": f64, "Channel Response h_11": c128[], "Frequency Offset": f64, "Delay (sec)": f64, "Channel Model": string, "Channel Response h_12": c128[], "Channel Response h_21": c128[], "Channel Response h_22": c128[]}
  T6 = cluster{"Active Antenna": string, "Carrier Frequency (Hz)": f64, "Gain (dB)": f64, "Generation Mode": enum{"Single Shot", "Simulate", "Continuous"}, "Device IP Address": string}
  T7 = cluster{"Equalization Method": string, "Channel Estimate Length": i32, "Equalizer Length": i32, "Equalizer Delay": i32}
  T8 = cluster{"Synchronization Method": string, "Fixed Offset": i32, "Symbol Timing Recovery Method": string, "Frame Detection Method": string, "Correct Frequency Offset": bool}
  T9 = cluster{"constellation": f64[], "oversampled data": f64[]}
  T10 = cluster{"Training Sequence 1 (derived)": c128[], "Zero Pad Length": i32, "Training Sequence 2 (derived)": c128[]}
  T11 = cluster{"Modulation Type": string, "Control Information\nfor Packet Header/Tail": T10, "RX Oversample Factor": i32, "Synchronization Options": T8, "Number of Data Symbols (Derived)": i32, "RX Sample Rate": f64, "Pulse Shaping Parameters": T3, "Channel Estimation/Equalization Parameters": T7}
  T12 = cluster{"Training Sequences ": string, "Zero Pad Length": i32}
  T13 = cluster{"Modulation Type": string, "Pulse Shaping Parameters": T3, "TX Oversample Factor": i32, "Packet Length (Bits)": i32, "TX Sample Rate": f64, "Control Information For Packet Header/Tail": T12}
  T14 = cluster{"Estimate h_11": c128[], "Estimate h_12": c128[], "Estimate h21": c128[], "Estimate h_22": c128[]}
  T15 = cluster{"SNR(dB)": f64, "freq. offset 1": f64, "delay 1": f64, "Channel estimates": T14, "freq. offset 2": f64, "delay 2": f64}
diagram:
  w1 = $"# of Iterations"
  # actual delay
  Property Node(instance in=$"Channel Model Parameters") -> (instance out=w2, "Delay (sec)"=w3)
  Property Node(instance in=$"RX HW Parameters", "Simulate"=TRUE) -> (instance out=w4)
  Property Node(instance in=$"Control Information for Packet Header/Tail") -> ("Zero Pad Length"=w5)
  Property Node(instance in=T10 {all zero or empty}, "Zero Pad Length"=w5) -> (instance out=w6)
  # Ts
  Property Node(instance in=$"RX modulation parameters", "Modulation Type"=$"Modulation Type", "Pulse Shaping Parameters"=$"Pulse Shaping Parameters", "Control Information\nfor Packet Header/Tail"=w6, "RX Oversample Factor"=$"RX Oversample Factor", "Channel Estimation/Equalization Parameters"=$"Channel Estimation/Equalization Parameters", "Synchronization Options"=$"Synchronization Options", "RX Sample Rate"=$"RX Sample Rate") -> (instance out=w7)
  Property Node(instance in=$"TX HW Parameters", "Generation Mode"="Simulate") -> (instance out=w8)
  Property Node(instance in=$"TX modulation Parameters", "Modulation Type"=$"Modulation Type", "Pulse Shaping Parameters"=$"Pulse Shaping Parameters", "TX Oversample Factor"=$"TX Oversample Factor", "Packet Length (Bits)"=$"Packet Length (Bits)", "Control Information For Packet Header/Tail"=$"Control Information for Packet Header/Tail", "TX Sample Rate"=$"TX Sample Rate") -> (instance out=w9)
  Divide(x=$"RX Oversample Factor", y=$"RX Sample Rate") -> w10
  for (N = w1) {
    Square Root(x=0.5) -> w14
    call "Gaussian White Noise.gvi"(samples=1, standard deviation=w14) -> (gaussian noise pattern=w15)
    call "Gaussian White Noise.gvi"(samples=1, standard deviation=w14) -> (gaussian noise pattern=w16)
    Real And Imaginary To Complex(x=w15, y=w16) -> w17
    call "Gaussian White Noise.gvi"(samples=1, standard deviation=w14) -> (gaussian noise pattern=w18)
    call "Gaussian White Noise.gvi"(samples=1, standard deviation=w14) -> (gaussian noise pattern=w19)
    Real And Imaginary To Complex(x=w18, y=w19) -> w20
    Property Node(instance in=w2) -> (instance out=w21, "Noise Power (dB)"=w22, "Delay (sec)"=w23, "Frequency Offset"=w24, "Channel Model"=w25)
    call "Gaussian White Noise.gvi"(samples=1, standard deviation=w14) -> (gaussian noise pattern=w26)
    call "Gaussian White Noise.gvi"(samples=1, standard deviation=w14) -> (gaussian noise pattern=w27)
    Real And Imaginary To Complex(x=w26, y=w27) -> w28
    call "Gaussian White Noise.gvi"(samples=1, standard deviation=w14) -> (gaussian noise pattern=w29)
    call "Gaussian White Noise.gvi"(samples=1, standard deviation=w14) -> (gaussian noise pattern=w30)
    Real And Imaginary To Complex(x=w29, y=w30) -> w31
    Property Node(instance in=w21, "Noise Power (dB)"=w22, "Channel Response h_11"=w20, "Frequency Offset"=w24, "Delay (sec)"=w23, "Channel Model"=w25, "Channel Response h_12"=w31, "Channel Response h_21"=w28, "Channel Response h_22"=w17) -> (instance out=w32)
    call "top_tx_MIMO.gvi"(HW Parameters=w8, Modulation Parameters=w9) -> (error out=w33, Output IQ Waveform 1=w34, Output IQ Waveform 2=w35)
    # IQ Waveforms
    call "top_rx_MIMO.gvi"(error in=w33, IQ Waveform 1=w34, HW Parameters=w4, RX Modulation Parameters=w7, IQ Waveform 2=w35, Channel Model Parameters=w32) -> (Eye Diagram 1=w36, Average Bit-Error Rate=w37, I Data RX 1=w38, Q Data RX 1=w39, Measured channel impairements=w40, I Data RX 2=w41, Eye Diagram 2=w42, error out=w43, Estimated Time Offset 1=w44, Power Delay Profile h_11=w45, Q Data RX 2=w46, Power Delay Profile h_12=w47, Power Delay Profile h_21=w48, Power Delay Profile h_22=w49, Estimated Time Offset 2=w50, Signal Constellation=w51)
    Property Node(instance in=w40) -> ("delay 1"=w52, "delay 2"=w53)
    Subtract(x=w3, y=w52) -> w54
    Divide(x=w54, y=w10) -> w55
    Square(x=w55) -> w56
    Subtract(x=w3, y=w53) -> w57
    Divide(x=w57, y=w10) -> w58
    Square(x=w58) -> w59
    $"Measured channel impairements" <- w40
    $"Received Constellation" <- w51
    $"I Data RX 1" <- w38
    $"Q Data RX 1" <- w39
    $"I Data RX 2" <- w41
    $"Q Data RX 2" <- w46
    $"Received Eye Diagram 1" <- w36
    $"Received Eye Diagram 2" <- w42
    $"error out" <- w43
    $"Estimated time Offset 1" <- w44
    $"Estimated time Offset 2" <- w50
    $"Power Delay Profile h_11" <- w45
    $"Power Delay Profile h_12" <- w47
    $"Power Delay Profile h_21" <- w48
    $"Power Delay Profile h_22" <- w49
    call "Gaussian White Noise.gvi"()
    append w37 to w11
    append w56 to w12
    append w59 to w13
  }
  call "Mean (DBL).gvi"(X=w12) -> (mean=w60)
  call "Mean (DBL).gvi"(X=w13) -> (mean=w61)
  Add(w60, w61) -> w62
  Divide(x=w62, y=2) -> w63
  $"Error Statistic (averaged over the two antennas)" <- w63
  call "Mean (DBL).gvi"(X=w11) -> (mean=w64)
  $"Average Bit-Error Rate" <- w64
