vi "test.gvi"   [LabVIEW NXG]
panel controls:
  "Array": c128[]
  "Array_2": f64[]
  "Array_3": f64[]
panel indicators:
  "appended array": f64[]
  "subarray": f64[][]
  "product": f64[]
diagram:
  Initialize Array(element=1, size=10) -> w1
  Reshape Array(inArray=w1, size=2, size=5)
  Initialize Array(element=0, size=10) -> w2
  Reshape Array(inArray=w2, size=2, size=5)
  Initialize Array(element=1, size=10) -> w3
  Initialize Array(element=2, size=10) -> w4
  Array Size(array=w4) -> (size(s)=w5)
  Divide(x=w5, y=3) -> w6
  Round Toward Positive Infinity(x=w6) -> w7
  for (N = w7) (iteration -> i1) {
    Multiply(3, i1) -> w9
    Array Subset(array=w4, index0=w9, length0=3) -> w10
    Array Subset(array=w3, index0=w9, length0=3) -> w11
    Build Array(w10, w11) -> w12
    append w12 to w8
  }
  Reshape Array(inArray=w8, size=25) -> w13
  $"appended array" <- w13
  Initialize Array(element=5, size=2, size=4) -> w14
  for (N = 2) {
    Array Index(array=w14) -> (out0[1, _]=w16)
    append w16 to w15
  }
  $subarray <- w15
  Multiply($Array_2, $Array_3) -> w17
  $product <- w17
