vi "top_rx_MIMO.gvi"   [LabVIEW NXG]
inputs:
  "# of Receive Iterations": i32 = 1
  "error in": error
  "IQ Waveform 1": cluster{"t0": f64, "dt": f64, "Y": c128[]} = {"t0"=0, "dt"=0.01, "Y"=[-0.0022595636299+2.50015037213e-18i, -0.00223099689251-5.57953480118e-16i, -0.00207189229063-9.03374646181e-16i, -0.00178298015595-8.22901056078e-16i, -0.00137217465826-7.80828213097e-16i, -0.000854524653002-7.23715403033e-16i, -0.000251776460603-7.9934495179e-16i, 0.000408448090976-9.27008880167e-16i, 0.00109383464663-8.26690346485e-16i, 0.00176887648159-1.04334400217e-15i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]}
  "HW Parameters": T1 = {"Active Antenna"="RX1", "Carrier Frequency (Hz)"=915000000, "Gain (dB)"=10, "Trigger Level"=0.01, "Bandwidth (Hz)"=40000000, "Reference Position (%)"=10, "Capture Time (s)"=0.002, "Simulate"=FALSE, "Device IP Address"="192.168.10.2"}
  "RX Modulation Parameters": T7 = {"Modulation Type"="QPSK", "Control Information\nfor Packet Header/Tail"={"Training Sequence 1 (derived)"=[], "Zero Pad Length"=8, "Training Sequence 2 (derived)"=[]}, "RX Oversample Factor"=20, "Synchronization Options"={"Synchronization Method"="Timing Estimation", "Fixed Offset"=0, "Symbol Timing Recovery Method"="Max Energy", "Frame Detection Method"="Sliding Correlator", "Correct Frequency Offset"=FALSE}, "Number of Data Symbols (Derived)"=250, "RX Sample Rate"=4000000, "Pulse Shaping Parameters"={"Modulation Type"="PSK", "Pulse Shaping Filter"="Raised Cosine", "Filter Parameter"=0.5, "Filter Length (Symbols)"=8}, "Channel Estimation/Equalization Parameters"={"Equalization Method"="Direct", "Channel Estimate Length"=2, "Equalizer Length"=4, "Equalizer Delay"=-1}}
  "Stop": bool
  "Parameters": i32
  "IQ Waveform 2": cluster{"t0": f64, "dt": f64, "Y": c128[]} = {"t0"=0, "dt"=0.01, "Y"=[-0.0022595636299+2.50015037213e-18i, -0.00223099689251-5.57953480118e-16i, -0.00207189229063-9.03374646181e-16i, -0.00178298015595-8.22901056078e-16i, -0.00137217465826-7.80828213097e-16i, -0.000854524653002-7.23715403033e-16i, -0.000251776460603-7.9934495179e-16i, 0.000408448090976-9.27008880167e-16i, 0.00109383464663-8.26690346485e-16i, 0.00176887648159-1.04334400217e-15i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]}
  "Channel Model Parameters": T11 = {"Noise Power (dB)"=-Inf, "Channel Model"="AWGN"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}
  "OFDM Parameters In": T14 = {"FFT size (N)"=64, "Length of CP (Lc)"=8, "Null Tones"=[0, 30, 31, 32], "Number of OFDM Symbols (derived)"=1, "Training Sequence FFT size"=0, "Training Sequence Length of CP"=0}
  "TX Modulation Parameters": T13 = {"Modulation Type"="QPSK", "Pulse Shaping Parameters"={"Modulation Type"="PSK", "Pulse Shaping Filter"="Raised Cosine", "Filter Parameter"=0.5, "Filter Length (Symbols)"=8}, "TX Oversample Factor"=20, "Packet Length (Bits)"=500, "TX Sample Rate"=4000000, "Control Information For Packet Header/Tail"={"Training Sequences "="Length 11 Barker Sequence", "Zero Pad Length"=8}}
outputs:
  "Eye Diagram 1": cluster{"t0": f64, "dt": f64, "Y": f64[]}[]
  "Average Bit-Error Rate": f64
  "I Data RX 1": waveform<f64>
  "Q Data RX 1": waveform<f64>
  "Measured channel impairements": T9
  "I Data RX 2": waveform<f64>
  "Eye Diagram 2": cluster{"t0": f64, "dt": f64, "Y": f64[]}[]
  "error out": error
  "Estimated Time Offset 1": i32
  "Power Delay Profile h_11": waveform<f64>
  "Q Data RX 2": waveform<f64>
  "Power Delay Profile h_12": waveform<f64>
  "Power Delay Profile h_21": waveform<f64>
  "Power Delay Profile h_22": waveform<f64>
  "Estimated Time Offset 2": i32
  "Signal Constellation": T10[]
panel controls:
  "Tab": i32
panel indicators:
  "Packet Detected": bool
  "Bit-Error Rate": f64
  "Coerced Bandwidth": f64
  "Coerced Carrier Frequency (Hz)": f64
  "Coerced Gain (dB)": f64
  "Key Bit Sequence": u8[]
  "Symbol Rate": f64
  "Overhead Offset": i32
types:
  T1 = cluster{"Active Antenna": string, "Carrier Frequency (Hz)": f64, "Gain (dB)": f64, "Trigger Level": f64, "Bandwidth (Hz)": f64, "Reference Position (%)": f64, "Capture Time (s)": f64, "Simulate": bool, "Device IP Address": string}
  T2 = cluster{"Training Sequence 1 (derived)": c128[], "Zero Pad Length": i32, "Training Sequence 2 (derived)": c128[]}
  T3 = cluster{"Synchronization Method": string, "Fixed Offset": i32, "Symbol Timing Recovery Method": string, "Frame Detection Method": string, "Correct Frequency Offset": bool}
  T4 = enum{"none", "Raised Cosine", "Root Raised Cos", "Gaussian"}
  T5 = cluster{"Modulation Type": enum{"FSK", "PSK", "QAM", "MSK", "PAM", "ASK"}, "Pulse Shaping Filter": T4, "Filter Parameter": f64, "Filter Length (Symbols)": i32}
  T6 = cluster{"Equalization Method": string, "Channel Estimate Length": i32, "Equalizer Length": i32, "Equalizer Delay": i32}
  T7 = cluster{"Modulation Type": string, "Control Information\nfor Packet Header/Tail": T2, "RX Oversample Factor": i32, "Synchronization Options": T3, "Number of Data Symbols (Derived)": i32, "RX Sample Rate": f64, "Pulse Shaping Parameters": T5, "Channel Estimation/Equalization Parameters": T6}
  T8 = cluster{"Element 1": c128[], "Element 2": c128[], "Element 3": c128[], "Element 4": c128[]}
  T9 = cluster{"SNR(dB)": f64, "freq. offset 1": f64, "delay 1": f64, "Channel estimates": T8, "freq. offset 2": f64, "delay 2": f64}
  T10 = cluster{"constellation": f64[], "oversampled data": f64[]}
  T11 = cluster{"Noise Power (dB)": f64, "Channel Response h_11": c128[], "Frequency Offset": f64, "Delay (sec)": f64, "Channel Model": string, "Channel Response h_12": c128[], "Channel Response h_21": c128[], "Channel Response h_22": c128[]}
  T12 = cluster{"Training Sequences ": string, "Zero Pad Length": i32}
  T13 = cluster{"Modulation Type": string, "Pulse Shaping Parameters": T5, "TX Oversample Factor": i32, "Packet Length (Bits)": i32, "TX Sample Rate": f64, "Control Information For Packet Header/Tail": T12}
  T14 = cluster{"FFT size (N)": i32, "Length of CP (Lc)": i32, "Null Tones": u32[], "Number of OFDM Symbols (derived)": i32, "Training Sequence FFT size": i32, "Training Sequence Length of CP": i32}
diagram:
  case ($"error in") {
    frame No Error {
      sequence {
        frame 0 {
          $"Packet Detected" <- FALSE
          # Initialize RF Hardware
          call "RXRF_init_MIMO.gvi"(HW Parameters In=$"HW Parameters", Modulation Parameters In=$"RX Modulation Parameters", error in (no error)=$"error in") -> (error out=w2, HW Parameters Out=w3, Modulation Parameters Out=w4, queue out=w5, USRP Session out=w6)
        }
        frame 1 {
          while (iteration -> i1) {
            # Configure RF for acquisition
            $"Packet Detected" <- FALSE
            call "RXRF_config_MIMO.gvi"(HW Parameters In=w3, USRP Session In=w6, queue in=w5, Modulation Parameters In=w4, error in (no error)=w2) -> (HW Parameters Out=w8, Modulation Parameters Out=w9, Simulate=w10, queue out=w11, error out=w12, USRP Session Out=w13, Coerced Carrier Frequency (Hz)=w14, Coerced Bandwidth=w15, Coerced Gain (dB)=w16)
            $"Coerced Carrier Frequency (Hz)" <- w14
            $"Coerced Bandwidth" <- w15
            $"Coerced Gain (dB)" <- w16
            # simulate?
            case (w10) {
              frame False, Default {
                call "RXRF_recv_MIMO.gvi"(USRP Session In=w13, HW Parameters In=w8, Modulation Parameters In=w9, error in (no error)=w12, queue in=w11) -> (Packet Detected=w19, USRP Session Out=w18, Modulation Parameters Out=w23, HW Parameters Out=w20, error out=w21, Received IQ waveform 1=w17, queue out=w24, Received IQ waveform 2=w22)
                Property Node(instance in=w23)
                Property Node(instance in=w23)
              }
              frame True {
                call "make_4_channels.gvi"(Channel Model Parameters=$"Channel Model Parameters") -> (Channel Model Parameters h_12=w25, Channel Model Parameters h_21=w26, Channel Model Parameters h_22=w27, Channel Model Parameters h_11=w28)
                call "channel.gvi"(Modulation Parameters In=$"TX Modulation Parameters", Input Complex Waveform=$"IQ Waveform 1", Channel Model Parameters=w28) -> (Output Complex Waveform=w29, error out=w30)
                Property Node(instance in=w9) -> ("RX Sample Rate"=w31)
                call "MT Resample (Complex Cluster).gvi"(input complex waveform=w29, desired sample rate=w31) -> (output complex waveform=w32)
                Property Node(instance in=w32) -> (instance out=w33, "t0"=w34, "dt"=w35, "Y"=w36)
                call "channel.gvi"(Modulation Parameters In=$"TX Modulation Parameters", Input Complex Waveform=$"IQ Waveform 2", Channel Model Parameters=w25, error in (no error)=w30) -> (Output Complex Waveform=w37, error out=w38)
                call "MT Resample (Complex Cluster).gvi"(input complex waveform=w37, desired sample rate=w31) -> (output complex waveform=w39)
                Property Node(instance in=w39) -> ("Y"=w40)
                Add(w36, w40) -> w41
                Property Node(instance in=w33, "t0"=w34, "dt"=w35, "Y"=w41) -> (instance out=w17)
                call "channel.gvi"(Modulation Parameters In=$"TX Modulation Parameters", Input Complex Waveform=$"IQ Waveform 1", Channel Model Parameters=w26, error in (no error)=w38) -> (Output Complex Waveform=w42, error out=w43)
                call "MT Resample (Complex Cluster).gvi"(input complex waveform=w42, desired sample rate=w31) -> (output complex waveform=w44)
                Property Node(instance in=w44) -> (instance out=w45, "t0"=w46, "dt"=w47, "Y"=w48)
                call "channel.gvi"(Modulation Parameters In=$"TX Modulation Parameters", Input Complex Waveform=$"IQ Waveform 2", Channel Model Parameters=w27, error in (no error)=w43) -> (Output Complex Waveform=w49, error out=w21)
                call "MT Resample (Complex Cluster).gvi"(input complex waveform=w49, desired sample rate=w31) -> (output complex waveform=w50)
                Property Node(instance in=w50) -> ("Y"=w51)
                Add(w48, w51) -> w52
                Property Node(instance in=w45, "t0"=w46, "dt"=w47, "Y"=w52) -> (instance out=w22)
                w18 = w13
                w19 = w10
                w20 = w8
                w23 = w9
                w24 = w11
              }
            }
            # Acquire if trigger level exceeded
            case (w19) {
              frame False, Default {
                w53 = w21
                w54 = w18
                w55 = default
                w56 = w24
                w57 = w20
              }
              frame True {
                $"Packet Detected" <- TRUE
                call "reveciver_plot_IQ (SubVI).gvi"(Received IQ waveform=w17, error in=w21) -> (Q=w58, I=w59, error out=w60)
                # Plot I and Q phases of received signal
                $"Q Data RX 1" <- w58
                $"I Data RX 1" <- w59
                call "reveciver_plot_IQ (SubVI).gvi"(Received IQ waveform=w22, error in=w60) -> (Q=w61, I=w62, error out=w63)
                call "receiver_MIMO.gvi"(HW Parameters In=w20, Modulation Parameters In=w23, queue in=w24, error in (no error)=w63, Input Complex Waveform 1=w17, OFDM Parameters In=$"OFDM Parameters In", Input Complex Waveform 2=w22) -> (error out=w53, HW Parameters Out=w57, queue out=w56, Measured channel impairements=w64, Overhead Offset=w65, Symbol Rate=w66, Bit-Error Rate=w55, Offset 1=w67, RX Waveforms Out 2=w68, RX Waveforms Out 1=w69, Received Constellation=w70, Power delay profiles=w71, Offset 2=w72, Key Bit Sequence=w73)
                $"Overhead Offset" <- w65
                $"Symbol Rate" <- w66
                $"Estimated Time Offset 1" <- w67
                $"Estimated Time Offset 2" <- w72
                $"Key Bit Sequence" <- w73
                $"Measured channel impairements" <- w64
                $"Signal Constellation" <- w70
                $"Q Data RX 2" <- w61
                $"I Data RX 2" <- w62
                Property Node(instance in=w69) -> ("Eye Diagram"=w74)
                $"Eye Diagram 1" <- w74
                Property Node(instance in=w68) -> ("Eye Diagram"=w75)
                $"Eye Diagram 2" <- w75
                Property Node(instance in=w71) -> ("Element 1"=w76, "Element 2"=w77, "Element 3"=w78, "Element 4"=w79)
                $"Power Delay Profile h_11" <- w76
                $"Power Delay Profile h_12" <- w77
                $"Power Delay Profile h_21" <- w78
                $"Power Delay Profile h_22" <- w79
                w54 = w18
              }
            }
            $"Bit-Error Rate" <- w55
            $"error out" <- w53
            Increment(x=i1) -> w80
            Is Equal(x=$"# of Receive Iterations", y=w80) -> w81
            Property Node(instance in=w53) -> ("status"=w82)
            Logical Or(w82, $Stop, w81) -> w83
            append w55 to w7
            stop if w83
          }
          call "Mean (DBL).gvi"(X=w7) -> (mean=w84)
          $"Average Bit-Error Rate" <- w84
        }
        frame 2 {
          # Close USRP session
          call "RXRF_close_MIMO (SubVI).gvi"(HW Parameters In=w57, error in=w53, queue in=w56, USRP Session=w54) -> (error out=w1)
          $"Packet Detected" <- FALSE
        }
      }
    }
    frame Error {
      w1 = $"error in"
    }
  }
  $"error out" <- w1
