vi "transmitter_MIMO.gvi"   [LabVIEW NXG]
inputs:
  "HW Parameters In": T2 = {"Active Antenna"="TX1", "Carrier Frequency (Hz)"=915000000, "Gain (dB)"=10, "Generation Mode"="Continuous", "Device IP Address"="192.168.10.3"}
  "Modulation Parameters In": T6 = {"Modulation Type"="QPSK", "Pulse Shaping Parameters"={"Modulation Type"="PSK", "Pulse Shaping Filter"="Raised Cosine", "Filter Parameter"=0.5, "Filter Length (Symbols)"=8}, "TX Oversample Factor"=20, "Packet Length (Bits)"=500, "TX Sample Rate"=100, "Control Information For Packet Header/Tail"={"Training Sequences "="Zadoff Chu", "Zero Pad Length"=8}}
  "error in": error
  "queue in": cluster{"Key Bit Sequence": Queue<u8[]>}
outputs:
  "error out": error
  "HW Parameters Out": T2
  "Modulation Parameters Out": T6
  "Output conplex waveform 1": cluster{"t0": f64, "dt": f64, "Y": c128[]}
  "OFDM Paramters out": T8
  "Number of Data Symbols": i32
  "Key Bit Sequence": i8[]
  "queue out": cluster{"Key Bit Sequence": Queue<u8[]>}
  "Eye Diagram 1": cluster{"t0": f64, "dt": f64, "Y": f64[]}[]
  "Transmitted Constellation 1": T1[]
  "Output complex waveform 2": cluster{"t0": f64, "dt": f64, "Y": c128[]}
  "Eye Diagram 2": cluster{"t0": f64, "dt": f64, "Y": f64[]}[]
  "Transmitted Constellation 2": T1[]
panel controls:
  "Tab": i32
  "Tab_2": i32
  "Training Sequences In": T7 = {"Length 11 Zadoff Chu 1 "=[1+0i, 1+0i, 1+0i, -1+0i, 1+0i, 1+0i, -1+0i, 1+0i, -1+0i, -1+0i, -1+0i], "Length 11 Zadoff Chu 2"=[1+0i, -1+0i, 1+0i, 1+0i, -1+0i, 1+0i, -1+0i, -1+0i, -1+0i, 1+0i, 1+0i]}
  "OFDM Parameters In": T8 = {"FFT size (N)"=64, "Length of CP (Lc)"=8, "Null Tones"=[0, 30, 31, 32], "Number of OFDM Symbols (derived)"=1, "Training Sequence FFT size"=0, "Training Sequence Length of CP"=0}
types:
  T1 = cluster{"constellation": f64[], "oversampled data": f64[]}
  T2 = cluster{"Active Antenna": string, "Carrier Frequency (Hz)": f64, "Gain (dB)": f64, "Generation Mode": enum{"Single Shot", "Simulate", "Continuous"}, "Device IP Address": string}
  T3 = enum{"none", "Raised Cosine", "Root Raised Cos", "Gaussian"}
  T4 = cluster{"Modulation Type": enum{"FSK", "PSK", "QAM", "MSK", "PAM", "ASK"}, "Pulse Shaping Filter": T3, "Filter Parameter": f64, "Filter Length (Symbols)": i32}
  T5 = cluster{"Training Sequences ": string, "Zero Pad Length": i32}
  T6 = cluster{"Modulation Type": string, "Pulse Shaping Parameters": T4, "TX Oversample Factor": i32, "Packet Length (Bits)": i32, "TX Sample Rate": f64, "Control Information For Packet Header/Tail": T5}
  T7 = cluster{"Length 11 Zadoff Chu 1 ": c128[], "Length 11 Zadoff Chu 2": c128[]}
  T8 = cluster{"FFT size (N)": i32, "Length of CP (Lc)": i32, "Null Tones": u32[], "Number of OFDM Symbols (derived)": i32, "Training Sequence FFT size": i32, "Training Sequence Length of CP": i32}
diagram:
  case ($"error in") {
    frame No Error {
      call "transmitter_init (SubVI).gvi"(Modulation Parameters In=$"Modulation Parameters In") -> (symbol rate=w3, number of data symbols=w4)
      Property Node(instance in=$"OFDM Parameters In") -> (instance out=w5, "FFT size (N)"=w6, "Length of CP (Lc)"=w7, "Null Tones"=w8, "Training Sequence FFT size"=w9, "Training Sequence Length of CP"=w10)
      call "source.gviprotected"(Modulation Parameters In=$"Modulation Parameters In", error in (no error)=$"error in") -> (Modulation Parameters Out=w11, output bit stream=w12, error out=w13)
      call "modulate.gviprotected"(Modulation Parameters In=w11, input bit stream=w12, error in (no error)=w13) -> (Modulation Parameters Out=w14, output symbols=w15, error out=w16)
      call "Alamouti_TX_student.gvi"(input symbols=w15, Modulation Parameters In=w14, error in (no error)=w16) -> (Modulation Parameters Out=w17, output 1=w18, output 2=w19, error out=w20)
      Array Size(array=w18) -> (size(s)=w21)
      Divide(x=w21, y=128) -> w22
      Property Node(instance in=w5, "FFT size (N)"=w6, "Length of CP (Lc)"=w7, "Null Tones"=w8, "Number of OFDM Symbols (derived)"=w22, "Training Sequence FFT size"=w9, "Training Sequence Length of CP"=w10) -> (instance out=w23)
      call "OFDM_modulator.gviprotected"(Input Symbols=w18, OFDM Parameters In=w23) -> (Output Symbols=w24)
      call "OFDM_modulator.gviprotected"(Input Symbols=w19, OFDM Parameters In=w23) -> (Output Symbols=w25)
      call "Training sequence preprocessing_student.gvi"(error in (no error)=w20, Training Sequences in=$"Training Sequences In") -> (Training Sequences out=w26, error out=w27)
      call "add_control_MIMO.gviprotected"(error in (no error)=w27, input 1=w24, Modulation Parameters In=w17, Training Sequences=w26, input 2=w25) -> (error out=w28, output 1=w29, Modulation Parameters Out=w30, output 2=w31)
      call "transmitter_enque (SubVI).gvi"(queue in=$"queue in", error in=w28, key bit stream 1=w12) -> (error out=w32, queue out=w33)
      call "pulse_shaping.gviprotected"(Modulation Parameters In=w30, input 1=w29, input 2=w31, error in (no error)=w32) -> (Modulation Parameters Out=w2, output 1=w34, output 2=w35, error out=w1)
      Property Node(instance in=w2) -> ("TX Sample Rate"=w36)
      Reciprocal(x=w36) -> w37
      call "make_MTwaveform.gvi"(dt=w37, Y=w34) -> (output MT waveform=w38)
      call "transmitter_generate_waveforms (SubVI).gvi"(complex waveform=w38, symbol rate (Hz)=w3, Y=w24) -> (transmitted constellation=w39, eye diagram=w40)
      $"Transmitted Constellation 1" <- w39
      $"OFDM Paramters out" <- w23
      # generate plots
      $"Eye Diagram 1" <- w40
      call "make_MTwaveform.gvi"(dt=w37, Y=w35) -> (output MT waveform=w41)
      call "transmitter_generate_waveforms (SubVI).gvi"(complex waveform=w41, symbol rate (Hz)=w3, Y=w25) -> (transmitted constellation=w42, eye diagram=w43)
      $"Transmitted Constellation 2" <- w42
      $"Eye Diagram 2" <- w43
      $"Number of Data Symbols" <- w4
      $"Key Bit Sequence" <- w12
      $"Output conplex waveform 1" <- w38
      $"Output complex waveform 2" <- w41
      $"queue out" <- w33
    }
    frame Error {
      w1 = $"error in"
      w2 = $"Modulation Parameters In"
    }
  }
  $"Modulation Parameters Out" <- w2
  $"error out" <- w1
  $"HW Parameters Out" <- $"HW Parameters In"
